# Grasshopper definition parametric_tower.gh (Grasshopper 1.0.7)

z_height = Z_HEIGHT_4()
z_height_2 = Z_HEIGHT()  # -> P, number_slider_2
z_height_3 = Z_HEIGHT_2()
z_height_4 = Z_HEIGHT_3()
material_thickness = Slider(4, range=2..8)

# ---- group: LEVEL2
floor_plan_editor = GenePool(Decimals=2, Maximum=1, Minimum=0, Value=[0.22, 0.52, 0.33, 0.71, 0.45, 0.59])

# ----
level_2 = LEVEL3(P=z_height_4, position=floor_plan_editor, P_2=z_height_4, L=floor_plan_editor)

# ---- group: LEVEL2 (continued)
pt = Point(level_2)

# ---- group: Level1
flor_plan_editor = GenePool(Decimals=2, Maximum=1, Minimum=0, Value=[0.74, 0.57, 0.64, 0.47, 0.63, 0.66])

# ----
level_1 = LEVEL1(P=z_height, position=flor_plan_editor, P_2=z_height, L=flor_plan_editor)  # -> inner_constraint_2, points

# ---- group: Level1 (continued)
pt_2 = Point(level_1.points)

# ----
core = CORE(X=level_1.inner_constraint_2, H=z_height_2.number_slider_2, Y=level_1.inner_constraint_2, A=level_1.inner_constraint_2)

# ---- group: LEVEL3
floor_plan_editor_2 = GenePool(Decimals=2, Maximum=1, Minimum=0, Value=[0.37, 0.44, 0.38, 0.29, 0.34, 0.19])

# ----
level_3 = LEVEL3(P=z_height_3, position=floor_plan_editor_2, P_2=z_height_3, L=floor_plan_editor_2)

# ---- group: LEVEL3 (continued)
pt_3 = Point(level_3)

# ---- group: LEVEL4
floor_plan_editor_3 = GenePool(Decimals=2, Maximum=1, Minimum=0, Value=[0.17, 0.43, 0.13, 0.36, 0.44, 0.17])

# ----
level_4 = LEVEL4(P=z_height_2.P, position=floor_plan_editor_3, P_2=z_height_2.P, L=floor_plan_editor_3)  # -> points, L_2

# ---- group: LEVEL4 (continued)
pt_4 = Point(level_4.points)

# ----
cluster = Cluster(points=[pt_2, pt, pt_3, pt_4], amount=level_4.L_2, B=core, D=material_thickness)  # -> C, B_2
geo_for_3dp = Geometry(cluster.B_2)

click_me = ClickMe(A=cluster.C, C=cluster.C, G=cluster.C)  # disabled
lasercurves = Geometry(click_me)

# ==== cluster CORE
X = ClusterInput()
Y = ClusterInput()
A = ClusterInput()
H = ClusterInput()

# ---- group: Core
rectangle = Rectangle(Plane=PlaneXY(0, 0, 0), XSize=X, YSize=Y, Radius=0)  # -> Rectangle, Length
division = Division(A=A, B=2)
multiplication = Multiplication(A=division, B=-1)
boxrec = BoxRectangle(Rectangle=rectangle.Rectangle, Height=H)
vec = VectorXYZ(XComponent=multiplication, YComponent=multiplication, ZComponent=0)  # -> Vector, Length
move = Move(Geometry=boxrec, Motion=vec.Vector)  # -> Geometry, Transform

# ----
G = ClusterOutput(move.Geometry)

# ==== cluster Z_HEIGHT
number_slider = Slider(150, range=0..200)
pt = ConstructPoint(XCoordinate=0, YCoordinate=0, ZCoordinate=number_slider)
number_slider_2 = ClusterOutput(number_slider)
xy = XYPlane(Origin=pt)
P = ClusterOutput(xy)

# ==== cluster Z_HEIGHT_2
pt = ConstructPoint(XCoordinate=0, YCoordinate=0, ZCoordinate=Slider(100, range=0..200))
xy = XYPlane(Origin=pt)
P = ClusterOutput(xy)

# ==== cluster Z_HEIGHT_3
pt = ConstructPoint(XCoordinate=0, YCoordinate=0, ZCoordinate=Slider(50, range=0..200))
xy = XYPlane(Origin=pt)
P = ClusterOutput(xy)

# ==== cluster Z_HEIGHT_4
pt = ConstructPoint(XCoordinate=0, YCoordinate=0, ZCoordinate=Slider(0, range=0..200))
xy = XYPlane(Origin=pt)
P = ClusterOutput(xy)

# ==== cluster LEVEL4
outer_constraint = Slider(30, range=10..50)
inner_constraint = Slider(10, range=10..50)
P = ClusterInput()
position = ClusterInput()
P_2 = ClusterInput()
L = ClusterInput()
floor_points = FlOORPOINTS(P=P, R=inner_constraint, position=position, P_2=P_2, R_2=outer_constraint, L=L)  # -> points, L_2
points = ClusterOutput(floor_points.points)
L_2 = ClusterOutput(floor_points.L_2)

# ==== cluster LEVEL3
outer_constraint = Slider(30, range=10..50)
inner_constraint = Slider(10, range=10..50)
P = ClusterInput()
position = ClusterInput()
P_2 = ClusterInput()
L = ClusterInput()
floor_points = FlOORPOINTS_2(P=P, R=inner_constraint, position=position, P_2=P_2, R_2=outer_constraint, L=L)
points = ClusterOutput(floor_points)

# ==== cluster LEVEL1
outer_constraint = Slider(30, range=10..50)
inner_constraint = Slider(10, range=10..50)
P = ClusterInput()
position = ClusterInput()
P_2 = ClusterInput()
L = ClusterInput()
floor_points = FlOORPOINTS_2(P=P, R=inner_constraint, position=position, P_2=P_2, R_2=outer_constraint, L=L)
inner_constraint_2 = ClusterOutput(inner_constraint)
points = ClusterOutput(floor_points)

# ==== cluster Cluster
points = ClusterInput()
amount = ClusterInput()
points_to_surface = GhPythonScript(points=points, amount=amount)  # -> flatten(surface), points; inputs points: list of Point3d, amount: Int32
# ---------- points_to_surface: Python ----------
"""Provides a scripting component.
    Inputs:
        curves: polylines
    Output:
        surface: surfaces"""

__author__ = "tellinia"
__version__ = "2022.03.08"

import rhinoscriptsyntax as rs
from Rhino import *
from Rhino.Commands import *
from Rhino.DocObjects import *
from Rhino.Geometry import *
from Rhino.Input.Custom import *
from scriptcontext import doc


# list comprehension 
point_list = [points[i:i + amount] for i in range(0, len(points), amount)]
print(len(point_list))

surface = []

for y in range(len(point_list)-1):
    for i in range(len(point_list[y])-1):
        planar_crv_01 = []
        planar_crv_02 = []

        planar_crv_01.append(rs.AddLine(point_list[y][i],point_list[y][i+1]))
        planar_crv_01.append(rs.AddLine(point_list[y][i+1],point_list[y+1][i]))
        planar_crv_01.append(rs.AddLine(point_list[y+1][i],point_list[y][i]))
        surface.append(rs.AddEdgeSrf(planar_crv_01))
        
        planar_crv_02.append(rs.AddLine(point_list[y+1][i],point_list[y+1][i+1]))
        planar_crv_02.append(rs.AddLine(point_list[y+1][i+1],point_list[y][i+1]))
        planar_crv_02.append(rs.AddLine(point_list[y][i+1],point_list[y+1][i]))
        surface.append(rs.AddEdgeSrf(planar_crv_02))
        
    planar_crv_03 = []
    planar_crv_04 = []
    ii = len(point_list[y])-1
    
    planar_crv_03.append(rs.AddLine(point_list[y][ii],point_list[y][0]))
    planar_crv_03.append(rs.AddLine(point_list[y][0],point_list[y+1][ii]))
    planar_crv_03.append(rs.AddLine(point_list[y+1][ii],point_list[y][ii]))
    surface.append(rs.AddEdgeSrf(planar_crv_03))
        
    planar_crv_04.append(rs.AddLine(point_list[y+1][ii],point_list[y+1][0]))
    planar_crv_04.append(rs.AddLine(point_list[y+1][0],point_list[y][0]))
    planar_crv_04.append(rs.AddLine(point_list[y][0],point_list[y+1][ii]))
    surface.append(rs.AddEdgeSrf(planar_crv_04))
# ---------- end points_to_surface ----------
join = BrepJoin(Breps=points_to_surface.surface)  # -> Breps, Closed
B = ClusterInput()
D = ClusterInput()
_3d_print_mesh = CapHoles(Brep=join.Breps)
remove_core = SolidDifference(BrepsA=_3d_print_mesh, BrepsB=B)
laser_contours = Contour(Shape=remove_core, Point=Point(0, 0, 0), Direction=Vector(0, 0, 1), Distance=D)
C = ClusterOutput(laser_contours)
B_2 = ClusterOutput(_3d_print_mesh)

# ==== cluster ClickMe
A = ClusterInput()
C = ClusterInput()
G = ClusterInput()
end = EndPoints(Curve=C)  # -> Start, End
pdecon = Deconstruct(Point=end.Start)  # -> XComponent, YComponent, ZComponent
sort = SortList(Keys=pdecon.ZComponent, ValuesA=A)  # -> Keys, ValuesA
multiplication = Multiplication(A=sort.Keys, B=Slider(10, range=0..100))
multiplication_2 = Multiplication(A=sort.Keys, B=-1)
vec = VectorXYZ(XComponent=0, YComponent=multiplication, ZComponent=multiplication_2)  # -> Vector, Length
pdecon_2 = Deconstruct(Point=vec.Vector)  # -> XComponent, YComponent, ZComponent
vec_2 = VectorXYZ(XComponent=0, YComponent=pdecon_2.YComponent, ZComponent=0)  # -> Vector, Length
move = Move(Geometry=G, Motion=vec.Vector)  # -> Geometry, Transform
G_2 = ClusterOutput(move.Geometry)
tag = TextTag3D(Location=vec_2.Vector, Text=pdecon.ZComponent, Size=2, Justification=5)

# ==== cluster FlOORPOINTS
L = ClusterInput()
P = ClusterInput()
R = ClusterInput()
P_2 = ClusterInput()
R_2 = ClusterInput()
lng = ListLength(List=L)
cir = Circle(Plane=P, Radius=R)
cir_2 = Circle(Plane=P_2, Radius=R_2)
divide = DivideCurve(Curve=cir, Count=lng, Kinks=False)  # -> Points, Tangents, Parameters
divide_2 = DivideCurve(Curve=cir_2, Count=lng, Kinks=False)  # -> Points, Tangents, Parameters
L_2 = ClusterOutput(lng)
position = ClusterInput()
ln = Line(StartPoint=divide.Points, EndPoint=divide_2.Points)
python = GhPythonScript(lines=ln, position=position)  # -> points, a; inputs lines: list, position: list
# ---------- python: Python ----------
__author__ = "tellinia"
__version__ = "2022.03.11"

import rhinoscriptsyntax as rs

points = []
count = 0

for l in lines:
    domain = rs.CurveDomain(l)
    pos_param = domain[0] + position[count]*(domain[1]-domain[0])
    my_param = rs.EvaluateCurve(l,pos_param)
    print(my_param)
    pt_on_l = rs.AddPoint(my_param)
    points.append(pt_on_l)
    
    count = count +1
# ---------- end python ----------
points = ClusterOutput(python.points)

# ==== cluster FlOORPOINTS_2
L = ClusterInput()
P = ClusterInput()
R = ClusterInput()
P_2 = ClusterInput()
R_2 = ClusterInput()
lng = ListLength(List=L)
cir = Circle(Plane=P, Radius=R)
cir_2 = Circle(Plane=P_2, Radius=R_2)
divide = DivideCurve(Curve=cir, Count=lng, Kinks=False)  # -> Points, Tangents, Parameters
divide_2 = DivideCurve(Curve=cir_2, Count=lng, Kinks=False)  # -> Points, Tangents, Parameters
position = ClusterInput()
ln = Line(StartPoint=divide.Points, EndPoint=divide_2.Points)
python = GhPythonScript(lines=ln, position=position)  # -> points, a; inputs lines: list, position: list; same code as python
points = ClusterOutput(python.points)
